# Grasshopper definition test.gh (Grasshopper 1.0.8)
# plug-ins: RhinoCodePluginGH, Park Design Space Planner, Weaverbird, NGon_RH8

construct_point = ConstructPoint(
    XCoordinate=Slider(311000, range=0..1000000),
    YCoordinate=Slider(2775000, range=0..10000000),
    ZCoordinate=Slider(16, range=0..100))
quad_remesh_settings = QuadRemeshSettings(
    TargetCount=Slider(10000, range=0..10000),
    AdaptiveSize=0,
    AdaptiveCount=False,
    HardEdges=False,
    SeamEdges=0,
    Symmetry=0,
    GuideCurves=0)
point = Point(Point(357.2859512, 283.3398584, 0))
mesh = Mesh(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)
# Easting  ≈ 311,000 m
# Northing ≈ 2,775,000 m
# Elevation = 16
curve = Curve(<curve referenced from the Rhino model>)
quad_remesh = QuadRemesh(Geometry=mesh, Settings=quad_remesh_settings)
vector_2pt = Vector2Pt(PointA=point, PointB=construct_point, Unitize=False)  # -> Vector, Length
mesh_edges = MeshEdges(Mesh=quad_remesh)  # -> AllE, NakedE
move = Move(Geometry=curve, Motion=vector_2pt.Vector)  # -> Geometry, Transform
boolean_toggle = BooleanToggle(True)
move_2 = Move(Geometry=mesh, Motion=vector_2pt.Vector)  # -> Geometry, Transform
panel = Panel("C:\Users\shyle\Downloads\al_safa_2_park_design_package_test7")
distribute_park_spaces = DistributeParkSpaces(
    Boundary=move.Geometry,
    DesignPackage=panel,
    Seed=Slider(4, range=0..10),
    Run=boolean_toggle,
    AllPrograms=True,
    Strategy="AUTO",
    UsePackageBoundary=boolean_toggle,
    Reseed=False,
    FastPreview=boolean_toggle)  # -> Bubbles, Centers, Names, Warnings, Summary, Nodes, NodeNames, Routes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
area = Area(Geometry=move.Geometry)  # -> Area, Centroid
evaluate_access_combination = EvaluateAccessCombination(DesignPackage=panel, MainIndex=0, SecondaryIndex=1, ServiceIndex=2, Run=boolean_toggle)  # -> MainPoint, SecondaryPoint, ServicePoint, SelectedIDs, Valid, HardViolations, CombinedPopulation, AdditionalPopulation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
read_access_candidates = ReadAccessCandidates(DesignPackage=panel, Run=boolean_toggle)  # -> CandidatePoints, CandidateIDs, EdgeIDs, MainEligible, SecondaryEligible, DropOffEligible, ServiceEligible, PopulationPull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
# {"authority":"designer_approved_competition_input","geometry_status":{"axes":"clipped_planar_design_guides","baraha_footprints":"alternative_candidate_proxies_not_simultaneous_geometry","dune_ridges_and_hollows":"unresolved_until_authoritative_terrain_mesh_is_connected"},"axes":[{"Id":"primary_sikka","Role":"ventilated_accessible_valley","azimuth_deg_from_north":21,"Basis":"site_long_axis_plus_southerly_epw_wind"},{"Id":"west_east_ventilation_cut","Role":"wind_erosion_passage","azimuth_deg_from_north":90,"Basis":"westerly_epw_wind"},{"Id":"northwest_southeast_ventilation_cut","Role":"wind_erosion_passage","azimuth_deg_from_north":135,"Basis":"northwesterly_epw_wind"}],"baraha_rules":{"generator":"movement_route_intersection","minimum_distinct_routes":2,"cluster_distance_m":6,"minimum_radius_m":6,"maximum_radius_m":14,"social_program_ids":["communityPlaza","smallEventZone","flexibleEventLawn","mainEntrancePlaza"],"designer_review_required":true},"terrain_rules":{"existing_ground_character":"nearly_flat","observed_relief_m":1.372,"preferred_landscape_ridge_height_m":{"minimum":0.6,"maximum":1.8},"architectural_ridge_height_m":{"minimum":2.5,"maximum":4},"hollow_policy":"retain_near_existing_grade_and_form_protection_with_surrounding_ridges","cut_fill_balance_required":true},"note":"No dune width, ridge surface, hollow, or elevation geometry is invented by ParkBubbles. Use the Terrain components with the authoritative mesh."}
button = Button()
number_slider = Slider(0, range=0..100)
cull_pattern = CullPattern(List=read_access_candidates.CandidatePoints, CullPattern=read_access_candidates.ServiceEligible)
# 1. 4 mandatory landscape systems are represented as overlay intent anchors until coverage targets are approved: Biodiversity Habitat, Native / Climate-Adapted Planting, Tree Planting / Canopy, Water-Sensitive Landscape / Bioswale.2. Using the EPSG:32640 boundary stored in site.json.1. The nominal area-program total is 16300 m2, while exclusive targets total 8275 m2 within the 14737 m2 boundary. Exported targets are retained because shared demand may overlap compatible territories.2. Could not place Small Event / Gathering Zone while satisfying the boundary, overlap, grid, and accepted mandatory relationship constraints.3. Could not place Nature / Interactive Play while satisfying the boundary, overlap, grid, and accepted mandatory relationship constraints.4. Could not place Picnic Area while satisfying the boundary, overlap, grid, and accepted mandatory relationship constraints.5. Could not place Toddler Play while satisfying the boundary, overlap, grid, and accepted mandatory relationship constraints.6. Could not place Sensory / Therapeutic Garden while satisfying the boundary, overlap, grid, and accepted mandatory relationship constraints.7. Could not place Wellness / Stretching Zone while satisfying the boundary, overlap, grid, and accepted mandatory relationship constraints.
c_script = CSharpScript(FolderPath=panel)  # -> out, SiteBoundary, SiteName, CRS, AreaIds, AreaNames, AreaCategories, AreaSelected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; inputs FolderPath: String, SelectedOnly: Boolean
# ---------- c_script: C# ----------
#region Usings
using System;
using System.Linq;
using System.IO;
using System.Collections;
using System.Collections.Generic;
using System.Drawing;
using System.Text.Json;

using Rhino;
using Rhino.Geometry;

using Grasshopper;
using Grasshopper.Kernel;
using Grasshopper.Kernel.Data;
using Grasshopper.Kernel.Types;
#endregion

public class Script_Instance : GH_ScriptInstance
{
    // ============================================================
    // PARK DESIGN PACKAGE LOADER
    //
    // INPUTS
    // ------------------------------------------------------------
    // FolderPath   : string
    // SelectedOnly : bool
    //
    // OUTPUTS
    // ------------------------------------------------------------
    // SiteBoundary
    // SiteName
    // CRS
    //
    // AreaIds
    // AreaNames
    // AreaCategories
    // AreaSelected
    // AreaPriority
    // MinAreas
    // TargetAreas
    // MaxAreas
    // AreaStatus
    //
    // NodeIds
    // NodeNames
    //
    // RouteIds
    // RouteNames
    //
    // GridIds
    // GridPoints
    // GridAreas
    // GridConstraints
    //
    // Opportunity
    // Demand
    // Suitability
    // Feasibility
    //
    // RelationshipSource
    // RelationshipTarget
    // RelationshipType
    // RelationshipMandatory
    // RelationshipAccepted
    //
    // UnresolvedAreaIds
    //
    // Debug
    //
    // ============================================================


    // ============================================================
    // INTERNAL DATA CLASSES
    // ============================================================

    private class AreaProgram
    {
        public string Id = "";
        public string Name = "";
        public string Category = "";

        public bool Selected = false;

        public double Priority = 0.0;

        public double MinArea = 0.0;
        public double TargetArea = 0.0;
        public double MaxArea = 0.0;

        public bool HasMin = false;
        public bool HasTarget = false;
        public bool HasMax = false;

        public string AreaStatus = "";

        public string SuitabilityField = "";
    }


    private class SimpleProgram
    {
        public string Id = "";
        public string Name = "";
        public string Category = "";

        public bool Selected = false;
        public double Priority = 0.0;
    }


    private class GridCell
    {
        public string Id = "";

        public Point3d Point =
            Point3d.Unset;

        public double Area = 0.0;

        public bool Constraint = false;

        public Dictionary<string, double> Scores =
            new Dictionary<string, double>();
    }


    private class Relationship
    {
        public string Source = "";
        public string Target = "";
        public string Type = "";

        public bool Mandatory = false;
        public bool Accepted = false;
    }


    // ============================================================
    // MAIN
    // ============================================================

    private void RunScript(
		string FolderPath,
		bool SelectedOnly,
		ref object SiteBoundary,
		ref object SiteName,
		ref object CRS,
		ref object AreaIds,
		ref object AreaNames,
		ref object AreaCategories,
		ref object AreaSelected,
		ref object AreaPriority,
		ref object MinAreas,
		ref object TargetAreas,
		ref object MaxAreas,
		ref object AreaStatus,
		ref object NodeIds,
		ref object NodeNames,
		ref object RouteIds,
		ref object RouteNames,
		ref object GridIds,
		ref object GridPoints,
		ref object GridAreas,
		ref object GridConstraints,
		ref object Opportunity,
		ref object Demand,
		ref object Suitability,
		ref object Feasibility,
		ref object RelationshipSource,
		ref object RelationshipTarget,
		ref object RelationshipType,
		ref object RelationshipMandatory,
		ref object RelationshipAccepted,
		ref object UnresolvedAreaIds,
		ref object Debug)
    {
        // ========================================================
        // VALIDATION
        // ========================================================

        List<string> debug =
            new List<string>();


        if (String.IsNullOrWhiteSpace(
            FolderPath))
        {
            Print(
                "FolderPath is empty.");

            return;
        }


        FolderPath =
            FolderPath.Trim();


        if (!Directory.Exists(
            FolderPath))
        {
            Print(
                "Folder does not exist:");

            Print(
                FolderPath);

            return;
        }


        string manifestPath =
            Path.Combine(
                FolderPath,
                "manifest.json");


        if (!File.Exists(
            manifestPath))
        {
            Print(
                "manifest.json not found in folder.");

            return;
        }


        // ========================================================
        // MANIFEST
        // ========================================================

        JsonDocument manifestDoc =
            ReadJson(
                manifestPath,
                debug);


        if (manifestDoc == null)
        {
            Debug = debug;
            return;
        }


        JsonElement manifest =
            manifestDoc.RootElement;


        string schemaVersion =
            GetString(
                manifest,
                "schema_version");


        string packageType =
            GetString(
                manifest,
                "package_type");


        string generatedAt =
            GetString(
                manifest,
                "generated_at");


        debug.Add(
            "Schema version: " +
            schemaVersion);


        debug.Add(
            "Package type: " +
            packageType);


        debug.Add(
            "Generated: " +
            generatedAt);


        // ========================================================
        // GET FILE MAP FROM MANIFEST
        // ========================================================

        JsonElement filesElement;


        if (!manifest.TryGetProperty(
            "files",
            out filesElement))
        {
            Print(
                "manifest.json does not contain 'files'.");

            manifestDoc.Dispose();

            return;
        }


        string siteFile =
            GetString(
                filesElement,
                "site");


        string areaFile =
            GetString(
                filesElement,
                "area_programs");


        string nodeFile =
            GetString(
                filesElement,
                "node_programs");


        string routeFile =
            GetString(
                filesElement,
                "route_programs");


        string gridFile =
            GetString(
                filesElement,
                "grid");


        string relationshipsFile =
            GetString(
                filesElement,
                "relationships");


        string unresolvedFile =
            GetString(
                filesElement,
                "unresolved");


        // ========================================================
        // RESOLVE PATHS
        // ========================================================

        string sitePath =
            ResolveFile(
                FolderPath,
                siteFile);


        string areaPath =
            ResolveFile(
                FolderPath,
                areaFile);


        string nodePath =
            ResolveFile(
                FolderPath,
                nodeFile);


        string routePath =
            ResolveFile(
                FolderPath,
                routeFile);


        string gridPath =
            ResolveFile(
                FolderPath,
                gridFile);


        string relationshipPath =
            ResolveFile(
                FolderPath,
                relationshipsFile);


        string unresolvedPath =
            ResolveFile(
                FolderPath,
                unresolvedFile);


        // ========================================================
        // READ SITE
        // ========================================================

        Curve siteBoundary = null;

        string siteName = "";

        string crs = "";


        if (File.Exists(
            sitePath))
        {
            JsonDocument siteDoc =
                ReadJson(
                    sitePath,
                    debug);


            if (siteDoc != null)
            {
                JsonElement siteRoot =
                    siteDoc.RootElement;


                siteName =
                    GetString(
                        siteRoot,
                        "site_name");


                crs =
                    GetString(
                        siteRoot,
                        "crs");


                JsonElement boundaryUTM;


                if (siteRoot.TryGetProperty(
                    "boundary_utm",
                    out boundaryUTM))
                {
                    siteBoundary =
                        ParseGeoJsonPolygon(
                            boundaryUTM);
                }


                siteDoc.Dispose();
            }
        }
        else
        {
            debug.Add(
                "Missing site file: " +
                sitePath);
        }


        // ========================================================
        // READ AREA PROGRAMS
        // ========================================================

        List<AreaProgram> allAreaPrograms =
            new List<AreaProgram>();


        if (File.Exists(
            areaPath))
        {
            JsonDocument areaDoc =
                ReadJson(
                    areaPath,
                    debug);


            if (areaDoc != null)
            {
                JsonElement root =
                    areaDoc.RootElement;


                JsonElement programs;


                if (root.TryGetProperty(
                    "programs",
                    out programs) &&
                    programs.ValueKind ==
                    JsonValueKind.Array)
                {
                    foreach (
                        JsonElement element
                        in programs.EnumerateArray())
                    {
                        AreaProgram program =
                            ParseAreaProgram(
                                element);


                        if (!String.IsNullOrWhiteSpace(
                            program.Id))
                        {
                            allAreaPrograms.Add(
                                program);
                        }
                    }
                }


                areaDoc.Dispose();
            }
        }
        else
        {
            debug.Add(
                "Missing area programs file: " +
                areaPath);
        }


        // ========================================================
        // FILTER AREA PROGRAMS
        // ========================================================

        List<AreaProgram> areaPrograms;


        if (SelectedOnly)
        {
            areaPrograms =
                allAreaPrograms
                .Where(p => p.Selected)
                .ToList();
        }
        else
        {
            areaPrograms =
                new List<AreaProgram>(
                    allAreaPrograms);
        }


        // ========================================================
        // READ NODE PROGRAMS
        // ========================================================

        List<SimpleProgram> nodePrograms =
            ReadSimplePrograms(
                nodePath,
                debug);


        // ========================================================
        // READ ROUTE PROGRAMS
        // ========================================================

        List<SimpleProgram> routePrograms =
            ReadSimplePrograms(
                routePath,
                debug);


        // ========================================================
        // READ GRID
        // ========================================================

        List<GridCell> gridCells =
            new List<GridCell>();


        if (File.Exists(
            gridPath))
        {
            JsonDocument gridDoc =
                ReadJson(
                    gridPath,
                    debug);


            if (gridDoc != null)
            {
                JsonElement root =
                    gridDoc.RootElement;


                JsonElement cells;


                if (root.TryGetProperty(
                    "cells",
                    out cells) &&
                    cells.ValueKind ==
                    JsonValueKind.Array)
                {
                    foreach (
                        JsonElement cellElement
                        in cells.EnumerateArray())
                    {
                        GridCell cell =
                            ParseGridCell(
                                cellElement);


                        gridCells.Add(
                            cell);
                    }
                }


                gridDoc.Dispose();
            }
        }
        else
        {
            debug.Add(
                "Missing grid file: " +
                gridPath);
        }


        // ========================================================
        // READ RELATIONSHIPS
        // ========================================================

        List<Relationship> relationships =
            new List<Relationship>();


        if (File.Exists(
            relationshipPath))
        {
            JsonDocument relationshipDoc =
                ReadJson(
                    relationshipPath,
                    debug);


            if (relationshipDoc != null)
            {
                JsonElement root =
                    relationshipDoc.RootElement;


                // ------------------------------------------------
                // ACCEPTED RULE EDGES
                // ------------------------------------------------

                JsonElement accepted;


                if (root.TryGetProperty(
                    "accepted_rule_edges",
                    out accepted) &&
                    accepted.ValueKind ==
                    JsonValueKind.Array)
                {
                    foreach (
                        JsonElement element
                        in accepted.EnumerateArray())
                    {
                        Relationship r =
                            ParseRelationship(
                                element);


                        r.Accepted =
                            true;


                        relationships.Add(
                            r);
                    }
                }


                // ------------------------------------------------
                // ADVISORY RELATIONSHIPS
                // ------------------------------------------------

                JsonElement advisory;


                if (root.TryGetProperty(
                    "advisory_relationships",
                    out advisory) &&
                    advisory.ValueKind ==
                    JsonValueKind.Array)
                {
                    foreach (
                        JsonElement element
                        in advisory.EnumerateArray())
                    {
                        Relationship r =
                            ParseRelationship(
                                element);


                        relationships.Add(
                            r);
                    }
                }


                relationshipDoc.Dispose();
            }
        }
        else
        {
            debug.Add(
                "Missing relationships file: " +
                relationshipPath);
        }


        // ========================================================
        // READ UNRESOLVED
        // ========================================================

        List<string> unresolvedAreaIds =
            new List<string>();


        if (File.Exists(
            unresolvedPath))
        {
            JsonDocument unresolvedDoc =
                ReadJson(
                    unresolvedPath,
                    debug);


            if (unresolvedDoc != null)
            {
                JsonElement root =
                    unresolvedDoc.RootElement;


                JsonElement unresolvedAreas;


                if (root.TryGetProperty(
                    "area_programs_without_recommendation",
                    out unresolvedAreas) &&
                    unresolvedAreas.ValueKind ==
                    JsonValueKind.Array)
                {
                    foreach (
                        JsonElement value
                        in unresolvedAreas.EnumerateArray())
                    {
                        if (value.ValueKind ==
                            JsonValueKind.String)
                        {
                            string id =
                                value.GetString();


                            if (!String.IsNullOrWhiteSpace(
                                id))
                            {
                                unresolvedAreaIds.Add(
                                    id);
                            }
                        }
                    }
                }


                unresolvedDoc.Dispose();
            }
        }


        // ========================================================
        // AREA OUTPUT LISTS
        // ========================================================

        List<string> areaIds =
            new List<string>();


        List<string> areaNames =
            new List<string>();


        List<string> areaCategories =
            new List<string>();


        List<bool> areaSelected =
            new List<bool>();


        List<double> areaPriority =
            new List<double>();


        List<double> minAreas =
            new List<double>();


        List<double> targetAreas =
            new List<double>();


        List<double> maxAreas =
            new List<double>();


        List<string> areaStatus =
            new List<string>();


        foreach (
            AreaProgram program
            in areaPrograms)
        {
            areaIds.Add(
                program.Id);


            areaNames.Add(
                program.Name);


            areaCategories.Add(
                program.Category);


            areaSelected.Add(
                program.Selected);


            areaPriority.Add(
                program.Priority);


            // ---------------------------------------------
            // NaN clearly means "no recommendation"
            // rather than pretending the value is zero.
            // ---------------------------------------------

            minAreas.Add(
                program.HasMin
                ? program.MinArea
                : Double.NaN);


            targetAreas.Add(
                program.HasTarget
                ? program.TargetArea
                : Double.NaN);


            maxAreas.Add(
                program.HasMax
                ? program.MaxArea
                : Double.NaN);


            areaStatus.Add(
                program.AreaStatus);
        }


        // ========================================================
        // NODE OUTPUT
        // ========================================================

        List<string> nodeIds =
            nodePrograms
            .Select(p => p.Id)
            .ToList();


        List<string> nodeNames =
            nodePrograms
            .Select(p => p.Name)
            .ToList();


        // ========================================================
        // ROUTE OUTPUT
        // ========================================================

        List<string> routeIds =
            routePrograms
            .Select(p => p.Id)
            .ToList();


        List<string> routeNames =
            routePrograms
            .Select(p => p.Name)
            .ToList();


        // ========================================================
        // GRID OUTPUTS
        // ========================================================

        List<string> gridIds =
            gridCells
            .Select(c => c.Id)
            .ToList();


        List<Point3d> gridPoints =
            gridCells
            .Select(c => c.Point)
            .ToList();


        List<double> gridAreas =
            gridCells
            .Select(c => c.Area)
            .ToList();


        List<bool> gridConstraints =
            gridCells
            .Select(c => c.Constraint)
            .ToList();


        // ========================================================
        // CREATE SCORE TREES
        //
        // Branch {i} == AreaIds[i]
        //
        // Each item in branch corresponds to GridPoints[j].
        //
        // Example:
        //
        // Suitability {0}
        //
        //   value 0 -> grid cell 0
        //   value 1 -> grid cell 1
        //   ...
        //
        // ========================================================

        DataTree<double> opportunityTree =
            new DataTree<double>();


        DataTree<double> demandTree =
            new DataTree<double>();


        DataTree<double> suitabilityTree =
            new DataTree<double>();


        DataTree<double> feasibilityTree =
            new DataTree<double>();


        for (int p = 0;
             p < areaPrograms.Count;
             p++)
        {
            AreaProgram program =
                areaPrograms[p];


            GH_Path path =
                new GH_Path(p);


            string opportunityKey =
                program.Id +
                "_opportunity";


            string demandKey =
                program.Id +
                "_demand";


            string suitabilityKey =
                program.Id +
                "_suitability";


            string feasibilityKey =
                program.Id +
                "_feasibility";


            foreach (
                GridCell cell
                in gridCells)
            {
                opportunityTree.Add(
                    GetScore(
                        cell,
                        opportunityKey),
                    path);


                demandTree.Add(
                    GetScore(
                        cell,
                        demandKey),
                    path);


                suitabilityTree.Add(
                    GetScore(
                        cell,
                        suitabilityKey),
                    path);


                feasibilityTree.Add(
                    GetScore(
                        cell,
                        feasibilityKey),
                    path);
            }
        }


        // ========================================================
        // RELATIONSHIP OUTPUT LISTS
        // ========================================================

        List<string> relationshipSource =
            new List<string>();


        List<string> relationshipTarget =
            new List<string>();


        List<string> relationshipType =
            new List<string>();


        List<bool> relationshipMandatory =
            new List<bool>();


        List<bool> relationshipAccepted =
            new List<bool>();


        foreach (
            Relationship relationship
            in relationships)
        {
            relationshipSource.Add(
                relationship.Source);


            relationshipTarget.Add(
                relationship.Target);


            relationshipType.Add(
                relationship.Type);


            relationshipMandatory.Add(
                relationship.Mandatory);


            relationshipAccepted.Add(
                relationship.Accepted);
        }


        // ========================================================
        // DEBUG / VALIDATION REPORT
        // ========================================================

        debug.Add(
            "Site: " +
            siteName);


        debug.Add(
            "CRS: " +
            crs);


        debug.Add(
            "All area programs: " +
            allAreaPrograms.Count);


        debug.Add(
            "Area programs output: " +
            areaPrograms.Count);


        debug.Add(
            "Selected area programs: " +
            allAreaPrograms.Count(
                p => p.Selected));


        debug.Add(
            "Node programs: " +
            nodePrograms.Count);


        debug.Add(
            "Route programs: " +
            routePrograms.Count);


        debug.Add(
            "Grid cells: " +
            gridCells.Count);


        debug.Add(
            "Relationships: " +
            relationships.Count);


        debug.Add(
            "Unresolved area programs: " +
            unresolvedAreaIds.Count);


        // ========================================================
        // SCORE VALIDATION
        // ========================================================

        int missingSuitability =
            0;


        int missingFeasibility =
            0;


        foreach (
            AreaProgram program
            in areaPrograms)
        {
            string suitabilityKey =
                program.Id +
                "_suitability";


            string feasibilityKey =
                program.Id +
                "_feasibility";


            foreach (
                GridCell cell
                in gridCells)
            {
                if (!cell.Scores.ContainsKey(
                    suitabilityKey))
                {
                    missingSuitability++;
                }


                if (!cell.Scores.ContainsKey(
                    feasibilityKey))
                {
                    missingFeasibility++;
                }
            }
        }


        debug.Add(
            "Missing suitability values: " +
            missingSuitability);


        debug.Add(
            "Missing feasibility values: " +
            missingFeasibility);


        // ========================================================
        // ASSIGN OUTPUTS
        // ========================================================

        SiteBoundary =
            siteBoundary;


        SiteName =
            siteName;


        CRS =
            crs;


        AreaIds =
            areaIds;


        AreaNames =
            areaNames;


        AreaCategories =
            areaCategories;


        AreaSelected =
            areaSelected;


        AreaPriority =
            areaPriority;


        MinAreas =
            minAreas;


        TargetAreas =
            targetAreas;


        MaxAreas =
            maxAreas;


        AreaStatus =
            areaStatus;


        NodeIds =
            nodeIds;


        NodeNames =
            nodeNames;


        RouteIds =
            routeIds;


        RouteNames =
            routeNames;


        GridIds =
            gridIds;


        GridPoints =
            gridPoints;


        GridAreas =
            gridAreas;


        GridConstraints =
            gridConstraints;


        Opportunity =
            opportunityTree;


        Demand =
            demandTree;


        Suitability =
            suitabilityTree;


        Feasibility =
            feasibilityTree;


        RelationshipSource =
            relationshipSource;


        RelationshipTarget =
            relationshipTarget;


        RelationshipType =
            relationshipType;


        RelationshipMandatory =
            relationshipMandatory;


        RelationshipAccepted =
            relationshipAccepted;


        UnresolvedAreaIds =
            unresolvedAreaIds;


        Debug =
            debug;


        manifestDoc.Dispose();
    }


    // ============================================================
    // READ JSON DOCUMENT
    // ============================================================

    private JsonDocument ReadJson(
        string path,
        List<string> debug)
    {
        try
        {
            if (!File.Exists(path))
            {
                debug.Add(
                    "File not found: " +
                    path);

                return null;
            }


            string text =
                File.ReadAllText(
                    path);


            JsonDocumentOptions options =
                new JsonDocumentOptions();


            options.AllowTrailingCommas =
                true;


            options.CommentHandling =
                JsonCommentHandling.Skip;


            return
                JsonDocument.Parse(
                    text,
                    options);
        }
        catch (Exception ex)
        {
            debug.Add(
                "Failed reading " +
                path +
                ": " +
                ex.Message);


            return null;
        }
    }


    // ============================================================
    // RESOLVE FILE FROM MANIFEST
    // ============================================================

    private string ResolveFile(
        string folder,
        string manifestFileName)
    {
        if (String.IsNullOrWhiteSpace(
            manifestFileName))
        {
            return "";
        }


        // --------------------------------------------------------
        // If manifest contains an absolute path,
        // use it directly.
        // --------------------------------------------------------

        if (Path.IsPathRooted(
            manifestFileName))
        {
            return
                manifestFileName;
        }


        return
            Path.Combine(
                folder,
                manifestFileName);
    }


    // ============================================================
    // PARSE AREA PROGRAM
    // ============================================================

    private AreaProgram ParseAreaProgram(
        JsonElement element)
    {
        AreaProgram program =
            new AreaProgram();


        program.Id =
            GetString(
                element,
                "id");


        program.Name =
            GetString(
                element,
                "name");


        program.Category =
            GetString(
                element,
                "category");


        program.Selected =
            GetBool(
                element,
                "selected");


        program.Priority =
            GetDouble(
                element,
                "priority",
                0.0);


        program.AreaStatus =
            GetString(
                element,
                "area_status");


        program.SuitabilityField =
            GetString(
                element,
                "suitability_field");


        // --------------------------------------------------------
        // MIN AREA
        // --------------------------------------------------------

        double value;


        if (TryGetNullableDouble(
            element,
            "minimum_area_m2",
            out value))
        {
            program.MinArea =
                value;


            program.HasMin =
                true;
        }


        // --------------------------------------------------------
        // TARGET AREA
        // --------------------------------------------------------

        if (TryGetNullableDouble(
            element,
            "target_area_m2",
            out value))
        {
            program.TargetArea =
                value;


            program.HasTarget =
                true;
        }


        // --------------------------------------------------------
        // MAX AREA
        // --------------------------------------------------------

        if (TryGetNullableDouble(
            element,
            "maximum_area_m2",
            out value))
        {
            program.MaxArea =
                value;


            program.HasMax =
                true;
        }


        return program;
    }


    // ============================================================
    // READ NODE / ROUTE PROGRAM FILE
    // ============================================================

    private List<SimpleProgram> ReadSimplePrograms(
        string path,
        List<string> debug)
    {
        List<SimpleProgram> result =
            new List<SimpleProgram>();


        if (String.IsNullOrWhiteSpace(
            path) ||
            !File.Exists(path))
        {
            debug.Add(
                "Program file missing: " +
                path);

            return result;
        }


        JsonDocument document =
            ReadJson(
                path,
                debug);


        if (document == null)
            return result;


        JsonElement root =
            document.RootElement;


        JsonElement programs;


        if (root.TryGetProperty(
            "programs",
            out programs) &&
            programs.ValueKind ==
            JsonValueKind.Array)
        {
            foreach (
                JsonElement element
                in programs.EnumerateArray())
            {
                SimpleProgram program =
                    new SimpleProgram();


                program.Id =
                    GetString(
                        element,
                        "id");


                program.Name =
                    GetString(
                        element,
                        "name");


                program.Category =
                    GetString(
                        element,
                        "category");


                program.Selected =
                    GetBool(
                        element,
                        "selected");


                program.Priority =
                    GetDouble(
                        element,
                        "priority",
                        0.0);


                if (!String.IsNullOrWhiteSpace(
                    program.Id))
                {
                    result.Add(
                        program);
                }
            }
        }


        document.Dispose();


        return result;
    }


    // ============================================================
    // PARSE GRID CELL
    // ============================================================

    private GridCell ParseGridCell(
        JsonElement element)
    {
        GridCell cell =
            new GridCell();


        cell.Id =
            GetString(
                element,
                "id");


        double x =
            GetDouble(
                element,
                "x",
                Double.NaN);


        double y =
            GetDouble(
                element,
                "y",
                Double.NaN);


        if (!Double.IsNaN(x) &&
            !Double.IsNaN(y))
        {
            cell.Point =
                new Point3d(
                    x,
                    y,
                    0);
        }


        cell.Area =
            GetDouble(
                element,
                "area_m2",
                0.0);


        cell.Constraint =
            GetBool(
                element,
                "constraint");


        // --------------------------------------------------------
        // SCORES OBJECT
        // --------------------------------------------------------

        JsonElement scores;


        if (element.TryGetProperty(
            "scores",
            out scores) &&
            scores.ValueKind ==
            JsonValueKind.Object)
        {
            foreach (
                JsonProperty property
                in scores.EnumerateObject())
            {
                if (property.Value.ValueKind ==
                    JsonValueKind.Number)
                {
                    double score;


                    if (property.Value.TryGetDouble(
                        out score))
                    {
                        cell.Scores[
                            property.Name] =
                            score;
                    }
                }
            }
        }


        return cell;
    }


    // ============================================================
    // PARSE RELATIONSHIP
    // ============================================================

    private Relationship ParseRelationship(
        JsonElement element)
    {
        Relationship relationship =
            new Relationship();


        relationship.Source =
            GetString(
                element,
                "source");


        relationship.Target =
            GetString(
                element,
                "target");


        relationship.Type =
            GetString(
                element,
                "type");


        relationship.Mandatory =
            GetBool(
                element,
                "mandatory");


        relationship.Accepted =
            GetBool(
                element,
                "accepted");


        return relationship;
    }


    // ============================================================
    // GEOJSON POLYGON -> RHINO CURVE
    // ============================================================

    private Curve ParseGeoJsonPolygon(
        JsonElement geoJson)
    {
        string type =
            GetString(
                geoJson,
                "type");


        if (!type.Equals(
            "Polygon",
            StringComparison.OrdinalIgnoreCase))
        {
            return null;
        }


        JsonElement coordinates;


        if (!geoJson.TryGetProperty(
            "coordinates",
            out coordinates))
        {
            return null;
        }


        if (coordinates.ValueKind !=
            JsonValueKind.Array)
        {
            return null;
        }


        // --------------------------------------------------------
        // GeoJSON Polygon structure:
        //
        // [
        //   [
        //     [x,y],
        //     [x,y],
        //     ...
        //   ]
        // ]
        //
        // First ring = exterior boundary.
        // --------------------------------------------------------

        JsonElement.ArrayEnumerator rings =
            coordinates.EnumerateArray();


        if (!rings.MoveNext())
            return null;


        JsonElement exterior =
            rings.Current;


        if (exterior.ValueKind !=
            JsonValueKind.Array)
        {
            return null;
        }


        List<Point3d> points =
            new List<Point3d>();


        foreach (
            JsonElement coordinate
            in exterior.EnumerateArray())
        {
            if (coordinate.ValueKind !=
                JsonValueKind.Array)
                continue;


            List<double> values =
                new List<double>();


            foreach (
                JsonElement number
                in coordinate.EnumerateArray())
            {
                if (number.ValueKind ==
                    JsonValueKind.Number)
                {
                    double d;


                    if (number.TryGetDouble(
                        out d))
                    {
                        values.Add(
                            d);
                    }
                }
            }


            if (values.Count >= 2)
            {
                points.Add(
                    new Point3d(
                        values[0],
                        values[1],
                        0));
            }
        }


        if (points.Count < 3)
            return null;


        // --------------------------------------------------------
        // Ensure closed
        // --------------------------------------------------------

        if (!points[0].EpsilonEquals(
            points[
                points.Count - 1],
            0.000001))
        {
            points.Add(
                points[0]);
        }


        Polyline polyline =
            new Polyline(
                points);


        return
            polyline.ToNurbsCurve();
    }


    // ============================================================
    // SCORE LOOKUP
    // ============================================================

    private double GetScore(
        GridCell cell,
        string key)
    {
        double value;


        if (cell.Scores.TryGetValue(
            key,
            out value))
        {
            return value;
        }


        return Double.NaN;
    }


    // ============================================================
    // GET STRING
    // ============================================================

    private string GetString(
        JsonElement element,
        string property)
    {
        JsonElement value;


        if (!element.TryGetProperty(
            property,
            out value))
        {
            return "";
        }


        if (value.ValueKind ==
            JsonValueKind.String)
        {
            return
                value.GetString() ??
                "";
        }


        return "";
    }


    // ============================================================
    // GET BOOL
    // ============================================================

    private bool GetBool(
        JsonElement element,
        string property)
    {
        JsonElement value;


        if (!element.TryGetProperty(
            property,
            out value))
        {
            return false;
        }


        if (value.ValueKind ==
            JsonValueKind.True)
        {
            return true;
        }


        if (value.ValueKind ==
            JsonValueKind.False)
        {
            return false;
        }


        return false;
    }


    // ============================================================
    // GET DOUBLE
    // ============================================================

    private double GetDouble(
        JsonElement element,
        string property,
        double fallback)
    {
        JsonElement value;


        if (!element.TryGetProperty(
            property,
            out value))
        {
            return fallback;
        }


        if (value.ValueKind !=
            JsonValueKind.Number)
        {
            return fallback;
        }


        double result;


        if (value.TryGetDouble(
            out result))
        {
            return result;
        }


        return fallback;
    }


    // ============================================================
    // TRY GET NULLABLE DOUBLE
    // ============================================================

    private bool TryGetNullableDouble(
        JsonElement element,
        string property,
        out double result)
    {
        result =
            0.0;


        JsonElement value;


        if (!element.TryGetProperty(
            property,
            out value))
        {
            return false;
        }


        if (value.ValueKind ==
            JsonValueKind.Null ||
            value.ValueKind ==
            JsonValueKind.Undefined)
        {
            return false;
        }


        if (value.ValueKind ==
            JsonValueKind.Number)
        {
            return
                value.TryGetDouble(
                    out result);
        }


        return false;
    }
}
# ---------- end c_script ----------
area_2 = Area(Geometry=distribute_park_spaces.Bubbles)  # -> Area, Centroid
area_3 = Area(Geometry=distribute_park_spaces.ResolvedBoundary)  # -> Area, Centroid
panel_2 = Panel(area.Area)
vector_2pt_2 = Vector2Pt(PointA=area.Centroid, PointB=area_3.Centroid, Unitize=False)  # -> Vector, Length
point_2 = Point(evaluate_access_combination.MainPoint)
point_3 = Point(<point referenced from the Rhino model>)
move_3 = Move(Geometry=move_2.Geometry, Motion=vector_2pt_2.Vector)  # -> Geometry, Transform
point_4 = Point(<point referenced from the Rhino model>)
boolean_toggle_2 = BooleanToggle(True)
curve_2 = Curve(distribute_park_spaces.Routes)
bake_park_planning_geometry = BakeParkPlanningGeometry(
    CleanGeometry=distribute_park_spaces.CleanGeometry,
    GeometryNames=distribute_park_spaces.CleanGeometryNames,
    LayerPaths=distribute_park_spaces.CleanGeometryLayers,
    Bake=button,
    ReplacePrevious=True)  # -> ObjectIDs, LayerPaths, Summary
curve_3 = Curve(distribute_park_spaces.Routes)
curve_4 = Curve(distribute_park_spaces.Bubbles)
number_slider_2 = Slider(2, range=0..10)
evaluate_terrain_routes = EvaluateTerrainRoutes(Mode="Walking", SampleSpacing=2, EnforceMaxSlope=False, MaxSlopePercent=0, Run=False)  # -> TerrainRoutes, HorizontalLength, TerrainLength, ElevationGain, ElevationLoss, MaximumSlope, AverageSlope, SlopeViolationLength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
text_tag = TextTag(Location=distribute_park_spaces.Centers, Text=distribute_park_spaces.Names)
curve_5 = Curve()
curve_6 = Curve()
generate_circulation = GenerateCirculation(
    Boundary=distribute_park_spaces.ResolvedBoundary,
    ProgramPolygons=distribute_park_spaces.Bubbles,
    ProgramIDs=distribute_park_spaces.AreaProgramIDs,
    ProgramNames=distribute_park_spaces.Names,
    MainEntrance=point_4,
    SecondaryEntrances=point_3,
    DesignPackage=panel,
    CellSize=Slider(10, range=0..10),
    RouteReuse=Slider(0.6, range=0..1),
    Run=boolean_toggle_2)  # -> PrimaryPaths, SecondaryPaths, TertiaryPaths, ServicePaths, AccessCandidates, SelectedAccess, GraphNodes, BlockedGridCells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
c_script_2 = CSharpScript(
    Centroids=area_2.Centroid,
    Areas=area_2.Area,
    Boundary=distribute_park_spaces.ResolvedBoundary,
    MinAspect=Slider(0.9, range=0..1),
    Seed=Slider(0, range=0..10))  # -> out, Cells, CellCenters, ActualAreas, TargetAreas, AreaError, Displacement, LocalPlane; inputs Centroids: list of Point3d, Areas: list of Double, Boundary: Curve, MinAspect: Double, Seed: Int32
# ---------- c_script_2: C# ----------
#region Usings
using System;
using System.Linq;
using System.Collections;
using System.Collections.Generic;
using System.Drawing;

using Rhino;
using Rhino.Geometry;

using Grasshopper;
using Grasshopper.Kernel;
using Grasshopper.Kernel.Data;
using Grasshopper.Kernel.Types;
#endregion

public class Script_Instance : GH_ScriptInstance
{
    // ============================================================
    // ROTATED + SEEDED SPATIAL RECTANGULAR CARTOGRAM / TREEMAP
    //
    // INPUTS
    // ------------------------------------------------------------
    // Centroids : List<Point3d>
    // Areas     : List<double>
    // Boundary  : Curve
    // MinAspect : double
    // Seed      : int
    //
    // OUTPUTS
    // ------------------------------------------------------------
    // Cells
    // CellCenters
    // ActualAreas
    // TargetAreas
    // AreaError
    // Displacement
    // LocalPlane
    //
    // ============================================================


    // ============================================================
    // ITEM
    // ============================================================

    private class Item
    {
        public int Index;

        public Point3d OriginalPoint;
        public Point3d LocalPoint;

        public double OriginalArea;
        public double ScaledArea;

        public Rect Rectangle;


        public Item(
            int index,
            Point3d originalPoint,
            Point3d localPoint,
            double area)
        {
            Index = index;

            OriginalPoint = originalPoint;
            LocalPoint = localPoint;

            OriginalArea = area;
            ScaledArea = area;
        }
    }


    // ============================================================
    // LOCAL RECTANGLE
    // ============================================================

    private class Rect
    {
        public double X;
        public double Y;

        public double W;
        public double H;


        public Rect(
            double x,
            double y,
            double w,
            double h)
        {
            X = x;
            Y = y;

            W = w;
            H = h;
        }


        public double Area
        {
            get
            {
                return W * H;
            }
        }


        public Point3d Center
        {
            get
            {
                return new Point3d(
                    X + W * 0.5,
                    Y + H * 0.5,
                    0);
            }
        }
    }


    // ============================================================
    // MAIN
    // ============================================================

    private void RunScript(
		List<Point3d> Centroids,
		List<double> Areas,
		Curve Boundary,
		double MinAspect,
		int Seed,
		ref object Cells,
		ref object CellCenters,
		ref object ActualAreas,
		ref object TargetAreas,
		ref object AreaError,
		ref object Displacement,
		ref object LocalPlane)
    {
        // ========================================================
        // VALIDATE
        // ========================================================

        if (Centroids == null ||
            Centroids.Count == 0)
        {
            Print(
                "No centroids supplied.");

            return;
        }


        if (Areas == null ||
            Areas.Count == 0)
        {
            Print(
                "No areas supplied.");

            return;
        }


        if (Boundary == null ||
            !Boundary.IsClosed)
        {
            Print(
                "Boundary must be a closed curve.");

            return;
        }


        int n =
            Math.Min(
                Centroids.Count,
                Areas.Count);


        if (MinAspect <= 0)
            MinAspect = 0.15;


        MinAspect =
            Math.Max(
                0.02,
                Math.Min(
                    1.0,
                    MinAspect));


        double tolerance =
            RhinoDocument != null
            ? RhinoDocument.ModelAbsoluteTolerance
            : 0.001;


        Random random =
            new Random(
                Seed);


        // ========================================================
        // CREATE SITE-ALIGNED PLANE
        //
        // Longest boundary edge = Local X-axis.
        // ========================================================

        Plane sitePlane;


        if (!CreateBoundaryPlane(
            Boundary,
            tolerance,
            out sitePlane))
        {
            Print(
                "Could not determine site orientation.");

            return;
        }


        // ========================================================
        // TRANSFORMS
        // ========================================================

        Transform worldToLocal =
            Transform.PlaneToPlane(
                sitePlane,
                Plane.WorldXY);


        Transform localToWorld =
            Transform.PlaneToPlane(
                Plane.WorldXY,
                sitePlane);


        // ========================================================
        // TRANSFORM BOUNDARY INTO LOCAL XY
        // ========================================================

        Curve localBoundary =
            Boundary.DuplicateCurve();


        localBoundary.Transform(
            worldToLocal);


        BoundingBox bb =
            localBoundary.GetBoundingBox(
                true);


        double parkWidth =
            bb.Max.X -
            bb.Min.X;


        double parkHeight =
            bb.Max.Y -
            bb.Min.Y;


        if (parkWidth <= tolerance ||
            parkHeight <= tolerance)
        {
            Print(
                "Invalid boundary dimensions.");

            return;
        }


        Rect park =
            new Rect(
                bb.Min.X,
                bb.Min.Y,
                parkWidth,
                parkHeight);


        // ========================================================
        // CREATE ITEMS IN LOCAL COORDINATES
        // ========================================================

        List<Item> items =
            new List<Item>();


        double totalRequestedArea =
            0;


        for (int i = 0;
             i < n;
             i++)
        {
            double area =
                Math.Max(
                    Areas[i],
                    0.0001);


            Point3d localPoint =
                Centroids[i];


            localPoint.Transform(
                worldToLocal);


            Item item =
                new Item(
                    i,
                    Centroids[i],
                    localPoint,
                    area);


            items.Add(
                item);


            totalRequestedArea +=
                area;
        }


        if (totalRequestedArea <=
            0.0001)
        {
            Print(
                "Total program area is invalid.");

            return;
        }


        // ========================================================
        // SCALE PROGRAM AREAS TO PARK RECTANGLE
        // ========================================================

        double parkArea =
            park.Area;


        double scale =
            parkArea /
            totalRequestedArea;


        foreach (
            Item item
            in items)
        {
            item.ScaledArea =
                item.OriginalArea *
                scale;
        }


        // ========================================================
        // SOLVE SEEDED SPATIAL TREEMAP
        // ========================================================

        SolveSpatialTreemap(
            items,
            park,
            MinAspect,
            random);


        // ========================================================
        // RETURN TO ORIGINAL ORDER
        // ========================================================

        items =
            items
            .OrderBy(
                x => x.Index)
            .ToList();


        // ========================================================
        // OUTPUT CONTAINERS
        // ========================================================

        List<Curve> outputCells =
            new List<Curve>();


        List<Point3d> outputCenters =
            new List<Point3d>();


        List<double> actualAreas =
            new List<double>();


        List<double> targetAreas =
            new List<double>();


        List<double> areaErrors =
            new List<double>();


        List<double> displacements =
            new List<double>();


        // ========================================================
        // CREATE WORLD-SPACE OUTPUT
        // ========================================================

        foreach (
            Item item
            in items)
        {
            Rect r =
                item.Rectangle;


            // ----------------------------------------------------
            // Cell curve in local XY
            // ----------------------------------------------------

            Curve cell =
                RectToCurve(
                    r);


            // ----------------------------------------------------
            // Transform back into boundary orientation
            // ----------------------------------------------------

            cell.Transform(
                localToWorld);


            outputCells.Add(
                cell);


            // ----------------------------------------------------
            // Center
            // ----------------------------------------------------

            Point3d center =
                r.Center;


            center.Transform(
                localToWorld);


            outputCenters.Add(
                center);


            // ----------------------------------------------------
            // Area
            // ----------------------------------------------------

            double actualArea =
                r.Area;


            actualAreas.Add(
                actualArea);


            targetAreas.Add(
                item.ScaledArea);


            double error =
                Math.Abs(
                    actualArea -
                    item.ScaledArea)
                /
                Math.Max(
                    item.ScaledArea,
                    0.0001)
                *
                100.0;


            areaErrors.Add(
                error);


            // ----------------------------------------------------
            // Distance to original centroid
            // ----------------------------------------------------

            double displacement =
                center.DistanceTo(
                    item.OriginalPoint);


            displacements.Add(
                displacement);
        }


        // ========================================================
        // ASSIGN OUTPUTS
        // ========================================================

        Cells =
            outputCells;


        CellCenters =
            outputCenters;


        ActualAreas =
            actualAreas;


        TargetAreas =
            targetAreas;


        AreaError =
            areaErrors;


        Displacement =
            displacements;


        LocalPlane =
            sitePlane;


        // ========================================================
        // REPORT
        // ========================================================

        Print(
            "Rotated seeded spatial treemap generated.");


        Print(
            "Seed: {0}",
            Seed);


        Print(
            "Park Area: {0:0.00}",
            parkArea);


        Print(
            "Requested Program Area: {0:0.00}",
            totalRequestedArea);


        Print(
            "Scale Factor: {0:0.000}",
            scale);


        Print(
            "Local Width: {0:0.00}",
            parkWidth);


        Print(
            "Local Height: {0:0.00}",
            parkHeight);


        Print(
            "Programs: {0}",
            n);
    }


    // ============================================================
    // RECURSIVE SEEDED SPATIAL TREEMAP
    // ============================================================

    private void SolveSpatialTreemap(
        List<Item> items,
        Rect rect,
        double minAspect,
        Random random)
    {
        // ========================================================
        // VALIDATE
        // ========================================================

        if (items == null ||
            items.Count == 0)
        {
            return;
        }


        // ========================================================
        // BASE CASE
        // ========================================================

        if (items.Count == 1)
        {
            items[0].Rectangle =
                rect;

            return;
        }


        // ========================================================
        // LOCAL CENTROID DISTRIBUTION
        // ========================================================

        double minPX =
            items.Min(
                i =>
                i.LocalPoint.X);


        double maxPX =
            items.Max(
                i =>
                i.LocalPoint.X);


        double minPY =
            items.Min(
                i =>
                i.LocalPoint.Y);


        double maxPY =
            items.Max(
                i =>
                i.LocalPoint.Y);


        double spreadX =
            maxPX -
            minPX;


        double spreadY =
            maxPY -
            minPY;


        // ========================================================
        // CHOOSE SPLIT DIRECTION
        //
        // Strong centroid signal:
        // preserve centroid direction.
        //
        // Ambiguous distribution:
        // use seeded variation.
        // ========================================================

        bool splitVertical;


        double minSpread =
            Math.Min(
                spreadX,
                spreadY);


        double maxSpread =
            Math.Max(
                spreadX,
                spreadY);


        double directionRatio;


        if (minSpread <
            0.0001)
        {
            directionRatio =
                maxSpread > 0
                ? Double.MaxValue
                : 1.0;
        }
        else
        {
            directionRatio =
                maxSpread /
                minSpread;
        }


        // --------------------------------------------------------
        // Strong directional preference
        // --------------------------------------------------------

        if (directionRatio >
            1.35)
        {
            splitVertical =
                spreadX >
                spreadY;
        }

        else
        {
            // ----------------------------------------------------
            // Seed controls ambiguous cases.
            //
            // Rectangle shape provides probability bias.
            // Wide rect -> higher chance vertical split.
            // Tall rect -> higher chance horizontal split.
            // ----------------------------------------------------

            double rectangleBias =
                rect.W /
                Math.Max(
                    rect.W +
                    rect.H,
                    0.0001);


            double randomValue =
                random.NextDouble();


            splitVertical =
                randomValue <
                rectangleBias;
        }


        // ========================================================
        // SORT CENTROIDS IN LOCAL SPACE
        // ========================================================

        List<Item> sorted;


        if (splitVertical)
        {
            sorted =
                items
                .OrderBy(
                    i =>
                    i.LocalPoint.X)
                .ThenBy(
                    i =>
                    i.LocalPoint.Y)
                .ToList();
        }

        else
        {
            sorted =
                items
                .OrderBy(
                    i =>
                    i.LocalPoint.Y)
                .ThenBy(
                    i =>
                    i.LocalPoint.X)
                .ToList();
        }


        // ========================================================
        // CALCULATE AREA BALANCE
        // ========================================================

        double totalArea =
            sorted.Sum(
                i =>
                i.ScaledArea);


        double halfArea =
            totalArea *
            0.5;


        double cumulative =
            0;


        double bestDifference =
            Double.MaxValue;


        // ========================================================
        // FIND OPTIMAL AREA SPLIT DIFFERENCE
        // ========================================================

        for (int i = 1;
             i < sorted.Count;
             i++)
        {
            cumulative +=
                sorted[
                    i - 1]
                .ScaledArea;


            double difference =
                Math.Abs(
                    cumulative -
                    halfArea);


            if (difference <
                bestDifference)
            {
                bestDifference =
                    difference;
            }
        }


        // ========================================================
        // COLLECT NEAR-OPTIMAL SPLITS
        //
        // Seed selects among these alternatives.
        // ========================================================

        List<int> possibleSplits =
            new List<int>();


        cumulative =
            0;


        double splitTolerance =
            totalArea *
            0.15;


        for (int i = 1;
             i < sorted.Count;
             i++)
        {
            cumulative +=
                sorted[
                    i - 1]
                .ScaledArea;


            double difference =
                Math.Abs(
                    cumulative -
                    halfArea);


            if (difference <=
                bestDifference +
                splitTolerance)
            {
                possibleSplits.Add(
                    i);
            }
        }


        // ========================================================
        // SEEDED SPLIT INDEX
        // ========================================================

        int splitIndex;


        if (possibleSplits.Count >
            0)
        {
            int randomIndex =
                random.Next(
                    possibleSplits.Count);


            splitIndex =
                possibleSplits[
                    randomIndex];
        }

        else
        {
            splitIndex =
                Math.Max(
                    1,
                    sorted.Count /
                    2);
        }


        // ========================================================
        // CREATE GROUPS
        // ========================================================

        List<Item> groupA =
            sorted
            .Take(
                splitIndex)
            .ToList();


        List<Item> groupB =
            sorted
            .Skip(
                splitIndex)
            .ToList();


        // Safety
        if (groupA.Count == 0 ||
            groupB.Count == 0)
        {
            splitIndex =
                Math.Max(
                    1,
                    sorted.Count /
                    2);


            groupA =
                sorted
                .Take(
                    splitIndex)
                .ToList();


            groupB =
                sorted
                .Skip(
                    splitIndex)
                .ToList();
        }


        // ========================================================
        // GROUP AREAS
        // ========================================================

        double areaA =
            groupA.Sum(
                i =>
                i.ScaledArea);


        double areaB =
            groupB.Sum(
                i =>
                i.ScaledArea);


        double ratio =
            areaA /
            Math.Max(
                areaA +
                areaB,
                0.0001);


        // ========================================================
        // PREVENT EXTREME RATIOS
        //
        // Normally unnecessary, but avoids numerical disaster.
        // ========================================================

        ratio =
            Math.Max(
                0.0001,
                Math.Min(
                    0.9999,
                    ratio));


        // ========================================================
        // ASPECT RATIO QUALITY TEST
        //
        // Seed variation is allowed,
        // but poor geometry can override it.
        // ========================================================

        if (splitVertical)
        {
            double widthA =
                rect.W *
                ratio;


            double widthB =
                rect.W -
                widthA;


            double aspectA =
                AspectRatio(
                    widthA,
                    rect.H);


            double aspectB =
                AspectRatio(
                    widthB,
                    rect.H);


            double currentQuality =
                Math.Min(
                    aspectA,
                    aspectB);


            if (currentQuality <
                minAspect)
            {
                // ------------------------------------------------
                // Test alternative horizontal split
                // ------------------------------------------------

                double heightA =
                    rect.H *
                    ratio;


                double heightB =
                    rect.H -
                    heightA;


                double altA =
                    AspectRatio(
                        rect.W,
                        heightA);


                double altB =
                    AspectRatio(
                        rect.W,
                        heightB);


                double alternativeQuality =
                    Math.Min(
                        altA,
                        altB);


                if (alternativeQuality >
                    currentQuality)
                {
                    splitVertical =
                        false;
                }
            }
        }

        else
        {
            double heightA =
                rect.H *
                ratio;


            double heightB =
                rect.H -
                heightA;


            double aspectA =
                AspectRatio(
                    rect.W,
                    heightA);


            double aspectB =
                AspectRatio(
                    rect.W,
                    heightB);


            double currentQuality =
                Math.Min(
                    aspectA,
                    aspectB);


            if (currentQuality <
                minAspect)
            {
                // ------------------------------------------------
                // Test alternative vertical split
                // ------------------------------------------------

                double widthA =
                    rect.W *
                    ratio;


                double widthB =
                    rect.W -
                    widthA;


                double altA =
                    AspectRatio(
                        widthA,
                        rect.H);


                double altB =
                    AspectRatio(
                        widthB,
                        rect.H);


                double alternativeQuality =
                    Math.Min(
                        altA,
                        altB);


                if (alternativeQuality >
                    currentQuality)
                {
                    splitVertical =
                        true;
                }
            }
        }


        // ========================================================
        // CREATE CHILD RECTANGLES
        // ========================================================

        Rect rectA;
        Rect rectB;


        if (splitVertical)
        {
            // ----------------------------------------------------
            // LEFT / RIGHT
            // ----------------------------------------------------

            double widthA =
                rect.W *
                ratio;


            double widthB =
                rect.W -
                widthA;


            rectA =
                new Rect(
                    rect.X,
                    rect.Y,
                    widthA,
                    rect.H);


            rectB =
                new Rect(
                    rect.X +
                    widthA,
                    rect.Y,
                    widthB,
                    rect.H);
        }

        else
        {
            // ----------------------------------------------------
            // BOTTOM / TOP
            // ----------------------------------------------------

            double heightA =
                rect.H *
                ratio;


            double heightB =
                rect.H -
                heightA;


            rectA =
                new Rect(
                    rect.X,
                    rect.Y,
                    rect.W,
                    heightA);


            rectB =
                new Rect(
                    rect.X,
                    rect.Y +
                    heightA,
                    rect.W,
                    heightB);
        }


        // ========================================================
        // RECURSE
        //
        // SAME RANDOM GENERATOR:
        // deterministic for the same seed.
        // ========================================================

        SolveSpatialTreemap(
            groupA,
            rectA,
            minAspect,
            random);


        SolveSpatialTreemap(
            groupB,
            rectB,
            minAspect,
            random);
    }


    // ============================================================
    // CREATE SITE PLANE FROM BOUNDARY
    //
    // Uses longest straight boundary edge.
    //
    // ============================================================

    private bool CreateBoundaryPlane(
        Curve boundary,
        double tolerance,
        out Plane plane)
    {
        plane =
            Plane.WorldXY;


        Polyline polyline;


        // ========================================================
        // BEST CASE: POLYLINE
        // ========================================================

        if (boundary.TryGetPolyline(
            out polyline))
        {
            if (polyline.Count <
                2)
            {
                return false;
            }


            double longest =
                0;


            Vector3d bestDirection =
                Vector3d.XAxis;


            for (int i = 0;
                 i <
                 polyline.Count - 1;
                 i++)
            {
                Vector3d direction =
                    polyline[
                        i + 1]
                    -
                    polyline[i];


                // Treemap is planar
                direction.Z =
                    0;


                double length =
                    direction.Length;


                if (length >
                    longest)
                {
                    longest =
                        length;


                    bestDirection =
                        direction;
                }
            }


            if (bestDirection.Length <=
                tolerance)
            {
                return false;
            }


            if (!bestDirection.Unitize())
            {
                return false;
            }


            Vector3d yAxis =
                new Vector3d(
                    -bestDirection.Y,
                    bestDirection.X,
                    0);


            if (!yAxis.Unitize())
            {
                return false;
            }


            Point3d center =
                GetBoundaryCentroid(
                    boundary);


            plane =
                new Plane(
                    center,
                    bestDirection,
                    yAxis);


            return
                plane.IsValid;
        }


        // ========================================================
        // FALLBACK:
        // SAMPLE CURVE SEGMENTS
        // ========================================================

        int samples =
            200;


        double bestLength =
            0;


        Vector3d best =
            Vector3d.XAxis;


        Point3d previous =
            boundary.PointAtStart;


        for (int i = 1;
             i <= samples;
             i++)
        {
            double normalized =
                (double)i /
                samples;


            double parameter =
                boundary.Domain.ParameterAt(
                    normalized);


            Point3d current =
                boundary.PointAt(
                    parameter);


            Vector3d direction =
                current -
                previous;


            direction.Z =
                0;


            double length =
                direction.Length;


            if (length >
                bestLength)
            {
                bestLength =
                    length;


                best =
                    direction;
            }


            previous =
                current;
        }


        if (best.Length <=
            tolerance)
        {
            return false;
        }


        if (!best.Unitize())
        {
            return false;
        }


        Vector3d perpendicular =
            new Vector3d(
                -best.Y,
                best.X,
                0);


        if (!perpendicular.Unitize())
        {
            return false;
        }


        plane =
            new Plane(
                GetBoundaryCentroid(
                    boundary),
                best,
                perpendicular);


        return
            plane.IsValid;
    }


    // ============================================================
    // BOUNDARY CENTROID
    // ============================================================

    private Point3d GetBoundaryCentroid(
        Curve boundary)
    {
        AreaMassProperties amp =
            AreaMassProperties.Compute(
                boundary);


        if (amp != null)
        {
            Point3d centroid =
                amp.Centroid;


            amp.Dispose();


            return centroid;
        }


        return
            boundary
            .GetBoundingBox(
                true)
            .Center;
    }


    // ============================================================
    // RECTANGLE -> CURVE
    // ============================================================

    private Curve RectToCurve(
        Rect rect)
    {
        Polyline polyline =
            new Polyline();


        polyline.Add(
            new Point3d(
                rect.X,
                rect.Y,
                0));


        polyline.Add(
            new Point3d(
                rect.X +
                rect.W,
                rect.Y,
                0));


        polyline.Add(
            new Point3d(
                rect.X +
                rect.W,
                rect.Y +
                rect.H,
                0));


        polyline.Add(
            new Point3d(
                rect.X,
                rect.Y +
                rect.H,
                0));


        polyline.Add(
            new Point3d(
                rect.X,
                rect.Y,
                0));


        return
            polyline
            .ToNurbsCurve();
    }


    // ============================================================
    // ASPECT RATIO
    //
    // 1.0 = square
    // 0.5 = 1:2
    // 0.2 = 1:5
    // ============================================================

    private double AspectRatio(
        double width,
        double height)
    {
        if (width <=
            0 ||
            height <=
            0)
        {
            return 0;
        }


        double min =
            Math.Min(
                width,
                height);


        double max =
            Math.Max(
                width,
                height);


        return
            min /
            max;
    }
}
# ---------- end c_script_2 ----------
curve_7 = Curve([generate_circulation.PrimaryPaths, generate_circulation.SecondaryPaths, generate_circulation.TertiaryPaths, generate_circulation.ServicePaths])
text_tag_2 = TextTag(Location=c_script_2.CellCenters, Text=distribute_park_spaces.Names)
point_5 = Point(<point referenced from the Rhino model>)
point_6 = Point(<point referenced from the Rhino model>)
treemap_path_network = TreemapPathNetwork(
    Boundary=distribute_park_spaces.ResolvedBoundary,
    Cells=c_script_2.Cells,
    ProgramIDs=distribute_park_spaces.AreaProgramIDs,
    ProgramNames=distribute_park_spaces.Names,
    MainEntrance=point_5,
    SecondaryEntrance=point_6,
    PrimaryWidth=3,
    SecondaryWidth=2,
    ServiceWidth=4,
    Run=Toggle(True))  # -> PrimaryPath, SecondaryPaths, ServicePath, Portals, PortalData, CorridorEdges, PathData, Warnings, Summary
weaverbird_s_loop_subdivision = WeaverbirdsLoopSubdivision(MeshCurves=move_3.Geometry, Level=Slider(2, range=0..10), SmoothNakedEdges=1)
curve_8 = Curve(treemap_path_network.ServicePath)
mesh_edges_2 = MeshEdges(Mesh=weaverbird_s_loop_subdivision)  # -> AllE, NakedE
text_tag_3 = TextTag()
point_7 = Point()
select_baraha_candidates = SelectBarahaCandidates(
    Boundary=distribute_park_spaces.ResolvedBoundary,
    CandidateFootprints=distribute_park_spaces.BarahaCandidateFootprints,
    CandidateData=distribute_park_spaces.BarahaCandidateData,
    MaximumCount=Slider(4, range=0..10),
    Clearance=2,
    Run=boolean_toggle_2)  # -> SelectedFootprints, SelectedCenters, SelectedData, RejectedFootprints, Decisions, Summary
deconstruct_mesh = DeconstructMesh(Mesh=weaverbird_s_loop_subdivision)  # -> Vertices, Faces, Colours, Normals
generate_dune_terrain = GenerateDuneTerrain(
    ExistingTerrain=weaverbird_s_loop_subdivision,
    Boundary=distribute_park_spaces.ResolvedBoundary,
    DuneAxes=distribute_park_spaces.DuneMorphologyAxes,
    DuneAxisNames=distribute_park_spaces.DuneAxisNames,
    SelectedBarahas=select_baraha_candidates.SelectedFootprints,
    LandscapeRidgeHeight=1.2,
    ArchitecturalRidgeHeight=Slider(8, range=0..10),
    RidgeOffset=Slider(20, range=0..100),
    RidgeHalfWidth=6,
    BarahaBermWidth=6,
    BalanceStrength=1,
    SmoothingPasses=3,
    Run=boolean_toggle_2)  # -> ProposedTerrain, RidgeCrestGuides, ValleyGuides, BarahaClearings, VertexDeltaZ, MaximumCut, MaximumFill, MeanActiveDelta, Summary
deconstruct_mesh_2 = DeconstructMesh(Mesh=generate_dune_terrain.ProposedTerrain)  # -> Vertices, Faces, Colours, Normals
negative = Negative()
distance = Distance(PointA=deconstruct_mesh.Vertices, PointB=deconstruct_mesh_2.Vertices)
mesh_2 = Mesh(generate_dune_terrain.ProposedTerrain)
bounds = Bounds(Numbers=distance)
curve_9 = Curve()
curve_10 = Curve(generate_dune_terrain.BarahaClearings)
curve_11 = Curve(generate_dune_terrain.ValleyGuides)
curve_12 = Curve(generate_dune_terrain.RidgeCrestGuides)
panel_3 = Panel(generate_dune_terrain.Summary)
deconstruct_domain = DeconstructDomain(Domain=bounds)  # -> Start, End
panel_4 = Panel(distance)
gradient = Gradient(
    LowerLimit=deconstruct_domain.Start,
    UpperLimit=deconstruct_domain.End,
    Parameter=distance,
    stops=[0: RGB(48, 18, 59), 0.0294: RGB(56, 40, 112), 0.0588: RGB(63, 62, 156), 0.0882: RGB(68, 82, 193), 0.118: RGB(70, 102, 221), 0.147: RGB(71, 122, 241)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])
estimate_park_cut_fill = EstimateParkCutFill(
    ExistingTerrain=weaverbird_s_loop_subdivision,
    ProposedTerrain=generate_dune_terrain.ProposedTerrain,
    GridSpacing=2,
    Run=boolean_toggle_2)  # -> SamplePoints, DeltaZ, CutVolume, FillVolume, NetVolume, TotalEarthwork, DisturbedArea, MaximumCutDepth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
evaluate_terrain_routes_2 = EvaluateTerrainRoutes(
    TerrainMesh=generate_dune_terrain.ProposedTerrain,
    Routes=distribute_park_spaces.Routes,
    Mode="Walking",
    SampleSpacing=2,
    EnforceMaxSlope=invert(False),
    MaxSlopePercent=Slider(5, range=0..10),
    Run=boolean_toggle_2)  # -> TerrainRoutes, HorizontalLength, TerrainLength, ElevationGain, ElevationLoss, MaximumSlope, AverageSlope, SlopeViolationLength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
custom_preview = CustomPreview(Geometry=deconstruct_mesh_2.Vertices, Material=gradient)
panel_5 = Panel(evaluate_terrain_routes_2.Summary)
curve_13 = Curve(evaluate_terrain_routes_2.TerrainRoutes)
panel_6 = Panel(estimate_park_cut_fill.Summary)
